# Grasshopper definition archive 1 - sinusoid center spine.gh (Grasshopper 0.9.76)

offset_top = Slider(3, range=0..20)
shelf_sections = Slider(4, range=0..6)
offset_bottom = Slider(2, range=0..20)
material_thickness = Slider(0.74, range=0..1.25)
crv = Curve(<curve referenced from the Rhino model>)
crv_2 = Curve(<curve referenced from the Rhino model>)
crv_3 = Curve(<curve referenced from the Rhino model>)
end = EndPoints(Curve=crv_2)  # -> Start, End
end_2 = EndPoints(Curve=crv)  # -> Start, End
devec = DeconstructVector(Vector=end_2.Start)  # -> XComponent, YComponent, ZComponent
devec_2 = DeconstructVector(Vector=end.Start)  # -> XComponent, YComponent, ZComponent
devec_3 = DeconstructVector(Vector=end_2.End)  # -> XComponent, YComponent, ZComponent
devec_4 = DeconstructVector(Vector=end.End)  # -> XComponent, YComponent, ZComponent
xy = XYPlane(Origin=Point(0, 0, 0))
max = Maximum(A=devec_2.ZComponent, B=devec_4.ZComponent)
max_2 = Maximum(A=devec_2.XComponent, B=devec_4.XComponent)
min = Minimum(A=devec.YComponent, B=devec_3.YComponent)
subtraction = Subtraction(A=max, B=offset_top)
dom = ConstructDomain(DomainStart=offset_bottom, DomainEnd=subtraction)
range = Range(Domain=dom, Steps=shelf_sections)
Z = UnitZ(Factor=range)
move = Move(Geometry=xy, Motion=Z)  # -> Geometry, Transform
subtraction_2 = Subtraction(A=subtraction, B=offset_bottom)
pcx = CurvePlane(Curve=crv, Plane=move.Geometry)  # -> Points, ParamsC, ParamsP
pcx_2 = CurvePlane(Curve=crv_2, Plane=move.Geometry)  # -> Points, ParamsC, ParamsP
xz = XZPlane(Origin=Point(0, 0, 0))
yz = YZPlane(Origin=Point(0, 0, 0))
pdecon = Deconstruct(Point=pcx.Points)  # -> XComponent, YComponent, ZComponent
pdecon_2 = Deconstruct(Point=pcx_2.Points)  # -> XComponent, YComponent, ZComponent
offset = Offset(Curve=crv, Distance=[-1.5, 1.5], Plane=yz, Corners=1)
offset_2 = Offset(Curve=crv_2, Distance=[-1.5, 1.5], Plane=xz, Corners=1)
X = UnitX(Factor=1)
division = Division(A=pdecon.YComponent, B=min)
division_2 = Division(A=pdecon_2.XComponent, B=max_2)
scale_nu = ScaleNU(Geometry=crv_3, Plane=PlaneXY(0, 0, 0), ScaleX=division_2, ScaleY=division, ScaleZ=1)  # -> Geometry, Transform
Z_2 = UnitZ(Factor=pdecon.ZComponent)
dispatch = Dispatch(List=flatten(offset), DispatchPattern=[True, False])  # -> ListA, ListB
dispatch_2 = Dispatch(List=flatten(offset_2), DispatchPattern=[True, False])  # -> ListA, ListB
move_2 = Move(Geometry=scale_nu.Geometry, Motion=Z_2)  # -> Geometry, Transform
edgesrf = EdgeSurface(CurveA=dispatch.ListA, CurveB=dispatch.ListB)
edgesrf_2 = EdgeSurface(CurveA=dispatch_2.ListA, CurveB=dispatch_2.ListB)
ln = Line(StartPoint=Z_2, EndPoint=pcx_2.Points)
ln_2 = Line(StartPoint=Z_2, EndPoint=pcx.Points)
X_2 = UnitX(Factor=material_thickness)
Y = UnitY(Factor=expr("-X", material_thickness))
edgesrf_3 = EdgeSurface(CurveA=move_2.Geometry, CurveB=ln_2, CurveC=ln)
extr = Extrude(Base=edgesrf, Direction=X_2)
extr_2 = Extrude(Base=edgesrf_2, Direction=Y)
Z_3 = UnitZ(Factor=material_thickness)
pt = ConstructPoint(XCoordinate=6, YCoordinate=0, ZCoordinate=max)
extr_3 = Extrude(Base=edgesrf_3, Direction=Z_3)
xz_2 = XZPlane(Origin=Point(0, 0, 0))
Z_4 = UnitZ(Factor=max)
curvepoint = PointOnCurve(crv_3, parameter=0.228)
rec_2pt = Rectangle2Pt(Plane=xz_2, PointA=Point(0, 0, 0), PointB=pt, Radius=0)  # -> Rectangle, Length
offset_3 = Slider(4, range=0..10)
ln_3 = Line(StartPoint=xz_2, EndPoint=Z_4)
amplitude = Slider(2, range=0..10)
division_3 = Division(A=Y, B=2)
division_4 = Division(A=material_thickness, B=2)
division_5 = Division(A=subtraction_2, B=shelf_sections)
pi = Pi(Factor=2)
neg = Negative(Value=division_3)
range_2 = Range(Domain=max, Steps=expr("X*20", max))
division_6 = Division(A=pi, B=division_5)
addition = Addition(A=offset_bottom, B=division_4)
subtraction_3 = Subtraction(A=range_2, B=addition)
multiplication = Multiplication(A=division_6, B=subtraction_3)
cos = Cosine(Value=multiplication)
series = Series(Start=addition, Step=division_5, Count=10)
multiplication_2 = Multiplication(A=cos, B=amplitude)
pt_2 = ConstructPoint(XCoordinate=0, YCoordinate=0, ZCoordinate=series)
pt_3 = ConstructPoint(XCoordinate=multiplication_2, YCoordinate=0, ZCoordinate=range_2)
X_3 = UnitX(Factor=offset_3)
nurbs = NurbsCurve(Vertices=pt_3, Degree=3, Periodic=False)  # -> Curve, Length, Domain
move_3 = Move(Geometry=nurbs.Curve, Motion=X_3)  # -> Geometry, Transform
edgesrf_4 = EdgeSurface(CurveA=ln_3, CurveB=move_3.Geometry)
rotate = Rotate(Geometry=edgesrf_4, Angle=-0.7853981634, Plane=PlaneXY(0, 0, 0))  # -> Geometry, Transform
transform = Transform(Geometry=[neg, division_3], Transform=rotate.Transform)
extr_4 = Extrude(Base=rotate.Geometry, Direction=transform)
join = BrepJoin(Breps=extr_4)  # -> Breps, Closed
cap = CapHoles(Brep=join.Breps)
