# Grasshopper definition postprocessing for 2d.gh (Grasshopper 0.9.76)

pipeline = GeometryPipeline(GroupByLayer=False, GroupByType=False, IncludeHidden=True, IncludeLocked=True, LayerFilter="Leg 2a", TypeFilter=4)
cls = Closed(Curve=pipeline)  # -> Closed, Periodic
dispatch = Dispatch(List=pipeline, DispatchPattern=cls.Closed)  # -> ListA, ListB
mat_l_thickness = Slider(0.72, range=0..1)
joint_line = Curve(dispatch.ListB)
shelf_part = Curve(dispatch.ListA)
explode = Explode(Curve=dispatch.ListA, Recursive=True)  # -> Segments, Vertices
division = Division(A=mat_l_thickness, B=2)
area = Area(Geometry=shelf_part)  # -> Area, Centroid
neg = Negative(Value=division)
plfit = PlaneFit(Points=explode.Vertices)  # -> Plane, Deviation
offset = Offset(Curve=joint_line, Distance=division, Plane=plfit.Plane, Corners=1)
offset_2 = Offset(Curve=joint_line, Distance=neg, Plane=plfit.Plane, Corners=1)
end = EndPoints(Curve=joint_line)  # -> Start, End
end_2 = EndPoints(Curve=flatten(offset))  # -> Start, End
end_3 = EndPoints(Curve=flatten(offset_2))  # -> Start, End
pt = Point(end_2.Start)
pt_2 = Point(end.Start)
pt_3 = Point(end_3.End)
pt_4 = Point(end_2.End)
pl_3pt = Plane3Pt(PointA=pt_2, PointB=pt, PointC=pt_4)
rec_2pt = Rectangle2Pt(Plane=flatten(pl_3pt), PointA=flatten(pt), PointB=flatten(pt_3), Radius=0)  # -> Rectangle, Length
scale_nu = ScaleNU(Geometry=rec_2pt.Rectangle, Plane=pl_3pt, ScaleX=1, ScaleY=2, ScaleZ=1)  # -> Geometry, Transform
rdiff = RegionDifference(CurvesA=shelf_part, CurvesB=scale_nu.Geometry)
dogbone = Dogbone(curve_to_dogbone=rdiff, dogbone_radius=Slider(0.125, range=0..1))  # -> outer_dogboned_curve, inner_dogboned_curve
output = Curve(dogbone.inner_dogboned_curve)

# ==== cluster Dogbone: Applies a dogbone of a certain radius to an arbitrary curve.
curve_to_dogbone = ClusterInput()
dogbone_radius = ClusterInput()
explode = Explode(Curve=curve_to_dogbone, Recursive=True)  # -> Segments, Vertices
plfit = PlaneFit(Points=explode.Vertices)  # -> Plane, Deviation
move = Move(Geometry=plfit.Plane, Motion=explode.Vertices)  # -> Geometry, Transform
cir = Circle(Plane=move.Geometry, Radius=dogbone_radius)
trim = TrimWithRegion(Curve=cir, Region=curve_to_dogbone)  # -> Inside, Outside
curvepoint = PointOnCurve(trim.Inside, parameter=0.498)
vec2pt = Vector2Pt(PointA=flatten(explode.Vertices), PointB=flatten(curvepoint), Unitize=False)  # -> Vector, Length
vec2pt_2 = Vector2Pt(PointA=flatten(curvepoint), PointB=flatten(explode.Vertices), Unitize=False)  # -> Vector, Length
move_2 = Move(Geometry=cir, Motion=vec2pt.Vector)  # -> Geometry, Transform
move_3 = Move(Geometry=cir, Motion=vec2pt_2.Vector)  # -> Geometry, Transform
runion = RegionUnion(Curves=flatten([move_2.Geometry, curve_to_dogbone]))
trim_2 = TrimWithRegions(Curve=curve_to_dogbone, Regions=move_3.Geometry)  # -> Inside, Outside
trim_3 = TrimWithRegions(Curve=move_3.Geometry, Regions=curve_to_dogbone)  # -> Inside, Outside
join = JoinCurves(Curves=flatten([trim_2.Outside, trim_3.Inside]), Preserve=False)
outer_dogboned_curve = ClusterOutput(runion)
inner_dogboned_curve = ClusterOutput(join)
