# Grasshopper definition shelf.gh (Grasshopper 0.9.76)

offset_top = Slider(3, range=0..20)
shelf_sections = Slider(3, range=0..6)
offset_bottom = Slider(4, range=0..20)
material_thickness = Slider(0.74, range=0..1.25)
crv = Curve(<curve referenced from the Rhino model>)
crv_2 = Curve(<curve referenced from the Rhino model>)
crv_3 = Curve(<curve referenced from the Rhino model>)
end = EndPoints(Curve=crv_2)  # -> Start, End
end_2 = EndPoints(Curve=crv)  # -> Start, End
devec = DeconstructVector(Vector=end_2.Start)  # -> XComponent, YComponent, ZComponent
devec_2 = DeconstructVector(Vector=end.Start)  # -> XComponent, YComponent, ZComponent
devec_3 = DeconstructVector(Vector=end_2.End)  # -> XComponent, YComponent, ZComponent
devec_4 = DeconstructVector(Vector=end.End)  # -> XComponent, YComponent, ZComponent
xy = XYPlane(Origin=Point(0, 0, 0))
max = Maximum(A=devec_2.ZComponent, B=devec_4.ZComponent)
max_2 = Maximum(A=devec_2.XComponent, B=devec_4.XComponent)
min = Minimum(A=devec.YComponent, B=devec_3.YComponent)
subtraction = Subtraction(A=max, B=offset_top)
dom = ConstructDomain(DomainStart=offset_bottom, DomainEnd=subtraction)
range = Range(Domain=dom, Steps=shelf_sections)
Z = UnitZ(Factor=range)
move = Move(Geometry=xy, Motion=Z)  # -> Geometry, Transform
subtraction_2 = Subtraction(A=subtraction, B=offset_bottom)
pcx = CurvePlane(Curve=crv, Plane=move.Geometry)  # -> Points, ParamsC, ParamsP
pcx_2 = CurvePlane(Curve=crv_2, Plane=move.Geometry)  # -> Points, ParamsC, ParamsP
xz = XZPlane(Origin=Point(0, 0, 0))
yz = YZPlane(Origin=Point(0, 0, 0))
pdecon = Deconstruct(Point=pcx.Points)  # -> XComponent, YComponent, ZComponent
pdecon_2 = Deconstruct(Point=pcx_2.Points)  # -> XComponent, YComponent, ZComponent
offset = Offset(Curve=crv, Distance=[-1.5, 1.5], Plane=yz, Corners=1)
offset_2 = Offset(Curve=crv_2, Distance=[-1.5, 1.5], Plane=xz, Corners=1)
X = UnitX(Factor=1)
division = Division(A=pdecon.YComponent, B=min)
division_2 = Division(A=pdecon_2.XComponent, B=max_2)
scale_nu = ScaleNU(Geometry=crv_3, Plane=PlaneXY(0, 0, 0), ScaleX=division_2, ScaleY=division, ScaleZ=1)  # -> Geometry, Transform
Z_2 = UnitZ(Factor=pdecon.ZComponent)
dispatch = Dispatch(List=flatten(offset), DispatchPattern=[True, False])  # -> ListA, ListB
dispatch_2 = Dispatch(List=flatten(offset_2), DispatchPattern=[True, False])  # -> ListA, ListB
move_2 = Move(Geometry=scale_nu.Geometry, Motion=Z_2)  # -> Geometry, Transform
edgesrf = EdgeSurface(CurveA=dispatch.ListA, CurveB=dispatch.ListB)
edgesrf_2 = EdgeSurface(CurveA=dispatch_2.ListA, CurveB=dispatch_2.ListB)
ln = Line(StartPoint=Z_2, EndPoint=pcx_2.Points)
ln_2 = Line(StartPoint=Z_2, EndPoint=pcx.Points)
X_2 = UnitX(Factor=material_thickness)
Y = UnitY(Factor=expr("-X", material_thickness))
shatter = Shatter(Curve=crv_2, Parameters=Slider(56, range=0..100))
shatter_2 = Shatter(Curve=crv, Parameters=Slider(34, range=0..100))
offset_3 = Slider(3, range=0..10)
amplitude = Slider(0.5, range=0..5)
angle = Slider(3, range=0..15)
extr = Extrude(Base=edgesrf, Direction=X_2)
extr_2 = Extrude(Base=edgesrf_2, Direction=Y)
dispatch_3 = Dispatch(List=shatter, DispatchPattern=[True, False])  # -> ListA, ListB
dispatch_4 = Dispatch(List=shatter_2, DispatchPattern=[True, False])  # -> ListA, ListB
division_3 = Division(A=material_thickness, B=2)
X_3 = UnitX(Factor=Slider(1, range=0..10))
Y_2 = UnitY(Factor=expr("-X", Slider(1, range=0..10)))
division_4 = Division(A=subtraction_2, B=shelf_sections)
pi = Pi(Factor=2)
range_2 = Range(Domain=max, Steps=expr("X*20", max))
edgesrf_3 = EdgeSurface(CurveA=move_2.Geometry, CurveB=ln_2, CurveC=ln)
yz_2 = YZPlane(Origin=Point(0, 0, 0))
division_5 = Division(A=pi, B=division_4)
xz_2 = XZPlane(Origin=Point(0, 0, 0))
addition = Addition(A=offset_bottom, B=division_3)
offset_4 = Offset(Curve=dispatch_4.ListA, Distance=[-1.5, 1.5], Plane=yz_2, Corners=1)
move_3 = Move(Geometry=extr, Motion=X_3)  # -> Geometry, Transform
move_4 = Move(Geometry=extr_2, Motion=Y_2)  # -> Geometry, Transform
Z_3 = UnitZ(Factor=material_thickness)
subtraction_3 = Subtraction(A=range_2, B=addition)
multiplication = Multiplication(A=division_5, B=subtraction_3)
offset_5 = Offset(Curve=dispatch_3.ListA, Distance=[-1.5, 1.5], Plane=xz_2, Corners=1)
cos = Cosine(Value=multiplication)
pt = ConstructPoint(XCoordinate=6, YCoordinate=0, ZCoordinate=max)
extr_3 = Extrude(Base=edgesrf_3, Direction=Z_3)
series = Series(Start=addition, Step=division_4, Count=10)
xz_3 = XZPlane(Origin=Point(0, 0, 0))
dispatch_5 = Dispatch(List=flatten(offset_4), DispatchPattern=[True, False])  # -> ListA, ListB
Z_4 = UnitZ(Factor=max)
multiplication_2 = Multiplication(A=cos, B=amplitude)
rec_2pt = Rectangle2Pt(Plane=xz_3, PointA=Point(0, 0, 0), PointB=pt, Radius=0)  # -> Rectangle, Length
dispatch_6 = Dispatch(List=flatten(offset_5), DispatchPattern=[True, False])  # -> ListA, ListB
pt_2 = ConstructPoint(XCoordinate=0, YCoordinate=0, ZCoordinate=series)
edgesrf_4 = EdgeSurface(CurveA=dispatch_5.ListA, CurveB=dispatch_5.ListB)
ln_3 = Line(StartPoint=xz_3, EndPoint=Z_4)
pt_3 = ConstructPoint(XCoordinate=multiplication_2, YCoordinate=0, ZCoordinate=range_2)
division_6 = Division(A=Y, B=2)
edgesrf_5 = EdgeSurface(CurveA=dispatch_6.ListA, CurveB=dispatch_6.ListB)
neg = Negative(Value=division_6)
X_4 = UnitX(Factor=material_thickness)
X_5 = UnitX(Factor=offset_3)
nurbs = NurbsCurve(Vertices=pt_3, Degree=3, Periodic=False)  # -> Curve, Length, Domain
extr_4 = Extrude(Base=edgesrf_4, Direction=X_4)
move_5 = Move(Geometry=nurbs.Curve, Motion=X_5)  # -> Geometry, Transform
extr_5 = Extrude(Base=edgesrf_5, Direction=Y)
Y_3 = UnitY(Factor=expr("-X", Slider(9, range=0..10)))
X_6 = UnitX(Factor=Slider(7, range=0..10))
curvepoint = PointOnCurve(move_5.Geometry, parameter=0.5)
move_6 = Move(Geometry=extr_5, Motion=Y_3)  # -> Geometry, Transform
move_7 = Move(Geometry=extr_4, Motion=X_6)  # -> Geometry, Transform
xz_4 = XZPlane(Origin=curvepoint)
rad = Radians(Degrees=angle)
rotate = Rotate(Geometry=move_5.Geometry, Angle=rad, Plane=xz_4)  # -> Geometry, Transform
edgesrf_6 = EdgeSurface(CurveA=ln_3, CurveB=rotate.Geometry)
rotate_2 = Rotate(Geometry=edgesrf_6, Angle=-0.7853981634, Plane=PlaneXY(0, 0, 0))  # -> Geometry, Transform
transform = Transform(Geometry=[neg, division_6], Transform=rotate_2.Transform)
extr_6 = Extrude(Base=rotate_2.Geometry, Direction=transform)
join = BrepJoin(Breps=extr_6)  # -> Breps, Closed
cap = CapHoles(Brep=join.Breps)
group = Group(Objects=[cap, move_6.Geometry, move_7.Geometry, move_3.Geometry, move_4.Geometry])
pt_4 = ConstructPoint(XCoordinate=0.5, YCoordinate=-0.5, ZCoordinate=0)
pt_5 = ConstructPoint(XCoordinate=0.5, YCoordinate=-0.5, ZCoordinate=0)
colour = ColourPicker(PickedColour=RGB(74, 148, 0))
colour_2 = ColourPicker(PickedColour=RGB(0, 121, 173))
move_8 = Move(Geometry=group, Motion=pt_4)  # -> Geometry, Transform
move_9 = Move(Geometry=extr_3, Motion=pt_5)  # -> Geometry, Transform
preview = CustomPreview(Geometry=move_8.Geometry, Shader=colour)
preview_2 = CustomPreview(Geometry=move_9.Geometry, Shader=colour_2)
ungroup = Ungroup(Group=move_8.Geometry)
sdiff = SolidDifference(BrepsA=move_9.Geometry, BrepsB=ungroup)
