# Grasshopper definition tray.gh (Grasshopper 0.9.6)

tray_depth = Slider(3.5, range=0..30)
tray_length = Slider(24.48, range=0..30)
tray_breadth = Slider(12.48, range=0..30)
groove_offset = Slider(0.3, range=0..30)
groove_height = Slider(0.3, range=0..30)
pocket_offset = Slider(1, range=0..2)
cut_depth = Slider(0.43, range=0..2)
pocket_height = Slider(1.5, range=0..2)
handle_height = Slider(0.75, range=0..2)
handle_width = Slider(4, range=0..10)
handle_offset = Slider(2.5, range=0..5)
acrylic_length = Slider(24, range=0..40)
acrylic_breadth = Slider(12, range=0..40)
secret_height = Slider(0.05, range=0..1)
groove_play = Slider(0.05, range=0..1)
groove_depth = Slider(0.24, range=0..2)
multiplication = Multiplication(A=tray_depth, B=2)
X = UnitX(Factor=tray_length)
Y = UnitY(Factor=tray_depth)
subtraction = Subtraction(A=cut_depth, B=groove_depth)
addition = Addition(A=tray_depth, B=1)
xy = XYPlane(Origin=Point(0, 0, 0))
addition_2 = Addition(A=multiplication, B=1)
division = Division(A=cut_depth, B=2)
addition_3 = Addition(A=tray_length, B=cut_depth)
addition_4 = Addition(A=subtraction, B=groove_play)
addition_5 = Addition(A=addition, B=handle_offset)
pt = PointXYZ(XComponent=expr("-x", division), YComponent=groove_offset, ZComponent=0, System=PlaneXY(0, 0, 0))
multiplication_2 = Multiplication(A=addition_4, B=2)
pt_2 = PointXYZ(XComponent=expr("x/2", tray_breadth), YComponent=addition_2, ZComponent=0, System=PlaneXY(0, 0, 0))
pt_3 = PointXYZ(XComponent=expr("x/2", tray_breadth), YComponent=addition_5, ZComponent=0, System=PlaneXY(0, 0, 0))
addition_6 = Addition(A=multiplication_2, B=acrylic_length)
addition_7 = Addition(A=multiplication_2, B=acrylic_breadth)
addition_8 = Addition(A=tray_depth, B=1)
addition_9 = Addition(A=pocket_height, B=pocket_offset)
Y_2 = UnitY(Factor=addition_9)
subtraction_2 = Subtraction(A=tray_length, B=cut_depth)
ellipse = Ellipse(Plane=pt_2, Radius1=expr("R1/2", tray_breadth), Radius2=1)  # -> Ellipse, Focus1, Focus2
subtraction_3 = Subtraction(A=tray_depth, B=addition_9)
panel = Panel(addition_7)
panel_2 = Panel(addition_6)
pt_4 = PointXYZ(XComponent=expr("-x", 0), YComponent=addition_8, ZComponent=0, System=PlaneXY(0, 0, 0))
move = Move(Geometry=pt_4, Motion=Y_2)  # -> Geometry, Transform
rectangle = Rectangle(Plane=pt_4, XSize=tray_breadth, YSize=tray_depth, Radius=0)  # -> Rectangle, Length
division_2 = Division(A=cut_depth, B=2)
addition_10 = Addition(A=subtraction_2, B=division_2)
X_2 = UnitX(Factor=addition_10)
X_3 = UnitX(Factor=expr("-F", division_2))
pt_5 = PointXYZ(XComponent=expr("-x", X_3), YComponent=pocket_offset, ZComponent=0, System=PlaneXY(0, 0, 0))
move_2 = Move(Geometry=pt_4, Motion=X_3)  # -> Geometry, Transform
addition_11 = Addition(A=addition_8, B=groove_offset)
division_3 = Division(A=cut_depth, B=2)
addition_12 = Addition(A=tray_breadth, B=cut_depth)
move_3 = Move(Geometry=move.Geometry, Motion=X_3)  # -> Geometry, Transform
Y_3 = UnitY(Factor=addition_11)
subtraction_4 = Subtraction(A=tray_breadth, B=cut_depth)
addition_13 = Addition(A=cut_depth, B=division_2)
pt_6 = PointXYZ(XComponent=expr("-x", division_3), YComponent=Y_3, ZComponent=0, System=PlaneXY(0, 0, 0))
addition_14 = Addition(A=subtraction_4, B=division_2)
X_4 = UnitX(Factor=addition_14)
rectangle_2 = Rectangle(Plane=pt_5, XSize=addition_13, YSize=pocket_height, Radius=0)  # -> Rectangle, Length
move_4 = Move(Geometry=rectangle_2.Rectangle, Motion=X_2)  # -> Geometry, Transform
rectangle_3 = Rectangle(Plane=xy, XSize=X, YSize=Y, Radius=0)  # -> Rectangle, Length
ellipse_2 = Ellipse(Plane=pt_3, Radius1=expr("R1/2", handle_width), Radius2=handle_height)  # -> Ellipse, Focus1, Focus2
runion = RegionUnion(Curves=[ellipse.Ellipse, rectangle.Rectangle])
rectangle_4 = Rectangle(Plane=move_3.Geometry, XSize=addition_13, YSize=subtraction_3, Radius=0)  # -> Rectangle, Length
rectangle_5 = Rectangle(Plane=pt, XSize=addition_3, YSize=groove_height, Radius=0)  # -> Rectangle, Length
rectangle_6 = Rectangle(Plane=pt_6, XSize=addition_12, YSize=groove_height, Radius=0)  # -> Rectangle, Length
rectangle_7 = Rectangle(Plane=move_2.Geometry, XSize=addition_13, YSize=pocket_offset, Radius=0)  # -> Rectangle, Length
move_5 = Move(Geometry=[rectangle_4.Rectangle, rectangle_7.Rectangle], Motion=X_4)  # -> Geometry, Transform
