# Grasshopper definition align to curve.gh (Grasshopper 0.9.56)

# Curve to Align
crv = Curve(<curve referenced from the Rhino model>)
# Curve to Align To
crv_2 = Curve(<curve referenced from the Rhino model>)
area = Area(Geometry=crv)  # -> Area, Centroid
divide = DivideCurve(Curve=crv_2, Count=Slider(7, range=0..10), Kinks=False)  # -> Points, Tangents, Parameters
Y = UnitY(Factor=1)
orient = OrientDirection(Geometry=crv, PointA=area.Centroid, DirectionA=Y, PointB=divide.Points, DirectionB=divide.Tangents)  # -> Geometry, Transform
