# Grasshopper definition parametric stand v1 - double support.gh (Grasshopper 0.9.56)

matl_thickness_cm = Slider(1.27, range=0..2)
cup_diameter_cm = Slider(8.5, range=0..20)
number_of_rod_holes = Slider(2, range=0..10)
holder_overhang = Slider(13, range=5..20)
opening_diameter = Slider(10.5, range=5..20)
holder_thickness = Slider(0.125, range=0..2)
cup_height_cm = Slider(12, range=0..20)
bend_angle = Slider(57, range=0..100)
number_of_rods = Slider(1, range=0..10)
rod_spacing_z = Slider(2, range=0..5)
rod_x_offset = Slider(0.1, range=0..5)
rod_z_offset = Slider(13, range=5..20)
rod_radius = Slider(0.635, range=0..5)
arch_height = Slider(1.6, range=0..100)
wall_width = Slider(3, range=0..100)
wall_height = Slider(17.5, range=0..100)
base_x = Slider(15, range=0..100)
base_y = Slider(13, range=0..100)
addition = Addition(A=wall_height, B=arch_height)

# ---- group: Cup
xy = XYPlane(Origin=Point(0, 0, 0))
division = Division(A=cup_diameter_cm, B=2)
cir = Circle(Plane=xy, Radius=division)
cyl = Cylinder(Base=xy, Radius=expr("R", division), Length=cup_height_cm)
boundary = BoundarySurfaces(Edges=cir)
cap = CapHoles(Brep=cyl)
offset = Offset(Surface=cyl, Distance=-0.5, Retrim=True)
cap_2 = CapHoles(Brep=offset)
Z = UnitZ(Factor=1)
move = Move(Geometry=cap_2, Motion=Z)  # -> Geometry, Transform
sdiff = SolidDifference(BrepsA=cap, BrepsB=move.Geometry)
preview = CustomPreview(Geometry=sdiff, Shader=ColourSwatch(SwatchColor=RGB(30, 114, 232)))

# ---- group: Base
dom = ConstructDomain(DomainStart=expr("-A/2", base_x), DomainEnd=expr("B/2", base_x))
dom_2 = ConstructDomain(DomainStart=expr("-A/2", base_y), DomainEnd=expr("B/2", base_y))
xy_2 = XYPlane(Origin=Point(0, 0, 0))
Z_2 = UnitZ(Factor=expr("-F", matl_thickness_cm))
rectangle = Rectangle(Plane=xy_2, XSize=dom, YSize=dom_2, Radius=0)  # -> Rectangle, Length
extr = Extrude(Base=rectangle.Rectangle, Direction=Z_2)
cap_3 = CapHoles(Brep=extr)
preview_2 = CustomPreview(Geometry=cap_3, Shader=ColourSwatch(SwatchColor=RGB(94, 72, 56)))

# ----
height = Slider(13, range=0..20)

# ---- group: Hario
drip_lip_diameter = Slider(6.25, range=0..20)
drip_flange_height = Slider(0.5, range=0..20)
drip_cone_top_diameter = Slider(11.5, range=0..20)
drip_flange_diameter = Slider(10, range=0..20)
drip_cone_bottom_diameter = Slider(4, range=0..20)
drip_cone_height = Slider(8.5, range=0..20)
drip_lip_height = Slider(1, range=0..20)
thickness = Slider(0.25, range=0..1)
addition_2 = Addition(A=drip_flange_height, B=drip_lip_height)
addition_3 = Addition(A=addition_2, B=drip_cone_height)
pt = ConstructPoint(XCoordinate=expr("X/2", drip_cone_bottom_diameter), YCoordinate=0, ZCoordinate=addition_2)
pt_2 = ConstructPoint(XCoordinate=expr("X/2", drip_cone_top_diameter), YCoordinate=0, ZCoordinate=addition_3)
pt_3 = ConstructPoint(XCoordinate=expr("X/2", drip_flange_diameter), YCoordinate=0, ZCoordinate=drip_lip_height)
pt_4 = ConstructPoint(XCoordinate=expr("X/2", drip_lip_diameter), YCoordinate=0, ZCoordinate=0)
pt_5 = ConstructPoint(XCoordinate=expr("X/2", drip_lip_diameter), YCoordinate=0, ZCoordinate=drip_lip_height)
pline = PolyLine(Vertices=[pt_4, pt_5, pt_3, pt, pt_2], Closed=False)
fillet = Fillet(Curve=pline, Radius=Slider(0.02, range=0..1))
offset_2 = Offset(Curve=fillet, Distance=thickness, Plane=PlaneXY(0, 0, 0), Corners=1)
end = EndPoints(Curve=pline)  # -> Start, End
end_2 = EndPoints(Curve=offset_2)  # -> Start, End
ln = Line(StartPoint=end.End, EndPoint=end_2.End)
ln_2 = Line(StartPoint=end.Start, EndPoint=end_2.Start)
pt_6 = ConstructPoint(XCoordinate=0, YCoordinate=0, ZCoordinate=0)
join = JoinCurves(Curves=flatten([fillet, ln_2, offset_2, ln]), Preserve=False)
line = LineSDL(Start=pt_6, Direction=Vector(0, 0, 1), Length=1)
Z_3 = UnitZ(Factor=height)
revsrf = Revolution(Curve=join, Axis=line, Domain=Domain(0, 6.283185307))
move_2 = Move(Geometry=revsrf, Motion=Z_3)  # -> Geometry, Transform
preview_3 = CustomPreview(Geometry=move_2.Geometry, Shader=ColourSwatch(SwatchColor=RGB(245, 245, 245)))

# ---- group: Stand
xz = XZPlane(Origin=Point(0, 0, 0))
division_2 = Division(A=bend_angle, B=2)
subtraction = Subtraction(A=180, B=division_2)
cir_2 = Circle(Plane=xz, Radius=rod_radius)
rad = Radians(Degrees=division_2)
rad_2 = Radians(Degrees=subtraction)
sin = Sine(Value=rad)
Z_4 = UnitZ(Factor=rod_spacing_z)
division_3 = Division(A=rod_radius, B=sin)
multiplication = Multiplication(A=matl_thickness_cm, B=2)
subtraction_2 = Subtraction(A=base_y, B=multiplication)
Y = UnitY(Factor=expr("-F", subtraction_2))

# ---- group: Rods
xz_2 = XZPlane(Origin=Point(0, 0, 0))
cyl_2 = Cylinder(Base=xz_2, Radius=rod_radius, Length=base_y)
series = Series(Start=0, Step=rod_spacing_z, Count=number_of_rod_holes)
cap_4 = CapHoles(Brep=cyl_2)
division_4 = Division(A=base_y, B=2)
Z_5 = UnitZ(Factor=series)
move_3 = Move(Geometry=cap_4, Motion=Z_5)  # -> Geometry, Transform
yz = YZPlane(Origin=Point(0, 0, 0))

# ---- group: Stand (continued)
subtraction_3 = Subtraction(A=division_4, B=matl_thickness_cm)

# ---- group: Walls
dom_3 = ConstructDomain(DomainStart=expr("-A/2", wall_width), DomainEnd=expr("B/2", wall_width))
dom_4 = ConstructDomain(DomainStart=expr("-A/2", matl_thickness_cm), DomainEnd=expr("B/2", matl_thickness_cm))
xy_3 = XYPlane(Origin=Point(0, 0, 0))
range = Range(Domain=wall_height, Steps=Slider(3, range=0..10))
subtraction_4 = Subtraction(A=base_x, B=wall_width)
expression = Expression(X=base_x, w=wall_width, Expression="-(X-w)/2")
rectangle_2 = Rectangle(Plane=xy_3, XSize=dom_3, YSize=dom_4, Radius=0)  # -> Rectangle, Length
expression_2 = Expression(Y=base_y, w=matl_thickness_cm, Expression="-(Y-w)/2")
division_5 = Division(A=subtraction_4, B=2)
pt_7 = ConstructPoint(XCoordinate=0, YCoordinate=0, ZCoordinate=range)
pt_8 = ConstructPoint(XCoordinate=division_5, YCoordinate=0, ZCoordinate=addition)
pt_9 = ConstructPoint(XCoordinate=subtraction_4, YCoordinate=0, ZCoordinate=reverse(range))
vec = VectorXYZ(XComponent=expression, YComponent=expr("-Y", expression_2), ZComponent=0)  # -> Vector, Length

# ----
addition_4 = Addition(A=expression, B=rod_x_offset)
entwine = Entwine(Branch00=pt_7, Branch01=pt_8, Branch02=pt_9)  # -> flatten(Result)

# ---- group: Stand (continued)
vec_2 = VectorXYZ(XComponent=expression, YComponent=subtraction_3, ZComponent=rod_z_offset)  # -> Vector, Length
move_4 = Move(Geometry=cir_2, Motion=vec_2.Vector)  # -> Geometry, Transform

# ----
pt_10 = PointPolar(BasePlane=move_4.Geometry, XYAngle=rad_2, ZAngle=0, Offset=division_3)

# ---- group: Rods (continued)
vec_3 = VectorXYZ(XComponent=addition_4, YComponent=division_4, ZComponent=rod_z_offset)  # -> Vector, Length
move_5 = Move(Geometry=move_3.Geometry, Motion=vec_3.Vector)  # -> Geometry, Transform
split = SplitList(List=move_5.Geometry, Index=number_of_rods)  # -> ListA, ListB
mirror = Mirror(Geometry=move_5.Geometry, Plane=yz)  # -> Geometry, Transform
mirror_2 = Mirror(Geometry=split.ListA, Plane=yz)  # -> Geometry, Transform

# ----
group = Group(Objects=[mirror_2.Geometry, split.ListA])

# ---- group: Rods (continued)
preview_4 = CustomPreview(Geometry=group, Shader=ColourSwatch(SwatchColor=RGB(207, 207, 207)))

# ---- group: Stand (continued)
tan = TangentLines(Point=pt_10, Circle=move_4.Geometry)  # -> Tangent1, Tangent2
scale = Scale(Geometry=tan.Tangent1, Center=pt_10, Factor=1.3)  # -> Geometry, Transform
join_2 = JoinCurves(Curves=flatten([scale.Geometry, tan.Tangent2]), Preserve=False)

# ----
end_3 = EndPoints(Curve=join_2)  # -> Start, End
mirror_3 = Mirror(Geometry=join_2, Plane=PlaneYZ(0, 0, 0))  # -> Geometry, Transform
end_4 = EndPoints(Curve=mirror_3.Geometry)  # -> Start, End
ln_3 = Line(StartPoint=end_3.Start, EndPoint=end_4.Start)
join_3 = JoinCurves(Curves=flatten([join_2, mirror_3.Geometry, ln_3]), Preserve=False)

# ---- group: Stand (continued)
offset_3 = Offset(Curve=join_3, Distance=expr("D/2", holder_thickness), Plane=PlaneXY(0, 0, 0), Corners=2)
offset_4 = Offset(Curve=join_3, Distance=expr("-D/2", holder_thickness), Plane=PlaneXY(0, 0, 0), Corners=2)
end_5 = EndPoints(Curve=offset_4)  # -> Start, End
end_6 = EndPoints(Curve=offset_3)  # -> Start, End
ln_4 = Line(StartPoint=end_6.Start, EndPoint=end_5.Start)
ln_5 = Line(StartPoint=end_6.End, EndPoint=end_5.End)
join_4 = JoinCurves(Curves=[offset_3, ln_4, offset_4, ln_5], Preserve=False)
extr_2 = Extrude(Base=join_4, Direction=Y)
cap_5 = CapHoles(Brep=extr_2)
preview_5 = CustomPreview(Geometry=cap_5, Shader=ColourSwatch(SwatchColor=RGB(161, 161, 161)))

# ---- group: Walls (continued)
nurbs = NurbsCurve(Vertices=entwine, Degree=3, Periodic=False)  # -> Curve, Length, Domain

# ----
swp1 = Sweep1(Rail=nurbs.Curve, Sections=rectangle_2.Rectangle, Miter=1)
cap_6 = CapHoles(Brep=swp1)

# ---- group: Walls (continued)
move_6 = Move(Geometry=cap_6, Motion=vec.Vector)  # -> Geometry, Transform
sdiff_2 = SolidDifference(BrepsA=move_6.Geometry, BrepsB=flatten([move_5.Geometry, mirror.Geometry]))
preview_6 = CustomPreview(Geometry=sdiff_2, Shader=ColourSwatch(SwatchColor=RGB(94, 72, 56)))
