# Grasshopper definition parametric stand v1 - single support.gh (Grasshopper 0.9.56)

matl_thickness_cm = Slider(1.27, range=0..2)
cup_diameter_cm = Slider(8.5, range=0..20)
rod_z_offset = Slider(10.5, range=5..20)
cup_height_cm = Slider(12, range=0..20)
number_of_rods = Slider(2, range=0..10)
number_of_rod_holes = Slider(3, range=0..10)
holder_overhang = Slider(13, range=5..20)
rod_spacing = Slider(2, range=0..5)
opening_diameter = Slider(10.5, range=5..20)
rod_radius = Slider(0.635, range=0..5)
holder_thickness = Slider(0.125, range=0..2)
wall_width = Slider(2.54, range=0..100)
wall_height = Slider(16, range=0..100)
base_x = Slider(15, range=0..100)
base_y = Slider(13, range=0..100)

# ---- group: Cup
xy = XYPlane(Origin=Point(0, 0, 0))
division = Division(A=cup_diameter_cm, B=2)
cir = Circle(Plane=xy, Radius=division)
cyl = Cylinder(Base=xy, Radius=expr("R", division), Length=cup_height_cm)
boundary = BoundarySurfaces(Edges=cir)
cap = CapHoles(Brep=cyl)
offset = Offset(Surface=cyl, Distance=-0.5, Retrim=True)
cap_2 = CapHoles(Brep=offset)
Z = UnitZ(Factor=1)
move = Move(Geometry=cap_2, Motion=Z)  # -> Geometry, Transform
sdiff = SolidDifference(BrepsA=cap, BrepsB=move.Geometry)
preview = CustomPreview(Geometry=sdiff, Shader=ColourSwatch(SwatchColor=RGB(30, 114, 232)))

# ---- group: Base
dom = ConstructDomain(DomainStart=expr("-A/2", base_x), DomainEnd=expr("B/2", base_x))
dom_2 = ConstructDomain(DomainStart=expr("-A/2", base_y), DomainEnd=expr("B/2", base_y))
xy_2 = XYPlane(Origin=Point(0, 0, 0))
Z_2 = UnitZ(Factor=expr("-F", matl_thickness_cm))
rectangle = Rectangle(Plane=xy_2, XSize=dom, YSize=dom_2, Radius=0)  # -> Rectangle, Length
extr = Extrude(Base=rectangle.Rectangle, Direction=Z_2)
cap_3 = CapHoles(Brep=extr)
preview_2 = CustomPreview(Geometry=cap_3, Shader=ColourSwatch(SwatchColor=RGB(94, 72, 56)))

# ----
height = Slider(12.5, range=0..20)

# ---- group: Hario
drip_lip_diameter = Slider(6.25, range=0..20)
drip_flange_height = Slider(0.5, range=0..20)
drip_cone_top_diameter = Slider(11.5, range=0..20)
drip_flange_diameter = Slider(10, range=0..20)
drip_cone_bottom_diameter = Slider(4, range=0..20)
drip_cone_height = Slider(8.5, range=0..20)
drip_lip_height = Slider(1, range=0..20)
thickness = Slider(0.25, range=0..1)
addition = Addition(A=drip_flange_height, B=drip_lip_height)
addition_2 = Addition(A=addition, B=drip_cone_height)
pt = ConstructPoint(XCoordinate=expr("X/2", drip_cone_bottom_diameter), YCoordinate=0, ZCoordinate=addition)
pt_2 = ConstructPoint(XCoordinate=expr("X/2", drip_cone_top_diameter), YCoordinate=0, ZCoordinate=addition_2)
pt_3 = ConstructPoint(XCoordinate=expr("X/2", drip_flange_diameter), YCoordinate=0, ZCoordinate=drip_lip_height)
pt_4 = ConstructPoint(XCoordinate=expr("X/2", drip_lip_diameter), YCoordinate=0, ZCoordinate=0)
pt_5 = ConstructPoint(XCoordinate=expr("X/2", drip_lip_diameter), YCoordinate=0, ZCoordinate=drip_lip_height)
pline = PolyLine(Vertices=[pt_4, pt_5, pt_3, pt, pt_2], Closed=False)
fillet = Fillet(Curve=pline, Radius=Slider(0.02, range=0..1))
offset_2 = Offset(Curve=fillet, Distance=thickness, Plane=PlaneXY(0, 0, 0), Corners=1)
end = EndPoints(Curve=pline)  # -> Start, End
end_2 = EndPoints(Curve=offset_2)  # -> Start, End
ln = Line(StartPoint=end.End, EndPoint=end_2.End)
ln_2 = Line(StartPoint=end.Start, EndPoint=end_2.Start)
pt_6 = ConstructPoint(XCoordinate=0, YCoordinate=0, ZCoordinate=0)
join = JoinCurves(Curves=flatten([fillet, ln_2, offset_2, ln]), Preserve=False)
line = LineSDL(Start=pt_6, Direction=Vector(0, 0, 1), Length=1)
Z_3 = UnitZ(Factor=height)
revsrf = Revolution(Curve=join, Axis=line, Domain=Domain(0, 6.283185307))
move_2 = Move(Geometry=revsrf, Motion=Z_3)  # -> Geometry, Transform
preview_3 = CustomPreview(Geometry=move_2.Geometry, Shader=ColourSwatch(SwatchColor=RGB(245, 245, 245)))

# ---- group: Stand
xz = XZPlane(Origin=Point(0, 0, 0))
cir_2 = Circle(Plane=xz, Radius=rod_radius)
X = UnitX(Factor=holder_overhang)
Z_4 = UnitZ(Factor=rod_spacing)
xz_2 = XZPlane(Origin=Point(0, 0, 0))
multiplication = Multiplication(A=matl_thickness_cm, B=2)
subtraction = Subtraction(A=base_y, B=multiplication)
Y = UnitY(Factor=expr("-F", subtraction))

# ---- group: Rods
xz_3 = XZPlane(Origin=Point(0, 0, 0))
series = Series(Start=0, Step=rod_spacing, Count=number_of_rod_holes)
cyl_2 = Cylinder(Base=xz_3, Radius=rod_radius, Length=base_y)
cap_4 = CapHoles(Brep=cyl_2)
Z_5 = UnitZ(Factor=series)
division_2 = Division(A=base_y, B=2)
move_3 = Move(Geometry=cap_4, Motion=Z_5)  # -> Geometry, Transform

# ---- group: Walls
dom_3 = ConstructDomain(DomainStart=expr("-A/2", wall_width), DomainEnd=expr("B/2", wall_width))
dom_4 = ConstructDomain(DomainStart=expr("-A/2", matl_thickness_cm), DomainEnd=expr("B/2", matl_thickness_cm))
xy_3 = XYPlane(Origin=Point(0, 0, 0))
expression = Expression(X=base_x, w=wall_width, Expression="-(X-w)/2")
rectangle_2 = Rectangle(Plane=xy_3, XSize=dom_3, YSize=dom_4, Radius=0)  # -> Rectangle, Length
expression_2 = Expression(Y=base_y, w=matl_thickness_cm, Expression="-(Y-w)/2")
boxrec = BoxRectangle(Rectangle=rectangle_2.Rectangle, Height=wall_height)
vec = VectorXYZ(XComponent=expression, YComponent=expr("-Y", expression_2), ZComponent=0)  # -> Vector, Length
vec_2 = VectorXYZ(XComponent=expression, YComponent=expression_2, ZComponent=0)  # -> Vector, Length; disabled
move_4 = Move(Geometry=boxrec, Motion=[vec.Vector, vec_2.Vector])  # -> Geometry, Transform

# ---- group: Stand (continued)
subtraction_2 = Subtraction(A=division_2, B=matl_thickness_cm)
vec_3 = VectorXYZ(XComponent=expression, YComponent=subtraction_2, ZComponent=rod_z_offset)  # -> Vector, Length
move_5 = Move(Geometry=cir_2, Motion=vec_3.Vector)  # -> Geometry, Transform
move_6 = Move(Geometry=move_5.Geometry, Motion=Z_4)  # -> Geometry, Transform
pt_7 = PointPolar(BasePlane=move_6.Geometry, XYAngle=1.570796327, ZAngle=0, Offset=rod_radius)
move_7 = Move(Geometry=pt_7, Motion=X)  # -> Geometry, Transform
bbox = BoundingBox(Content=[move_6.Geometry, move_5.Geometry], Plane=PlaneXY(0, 0, 0), UnionBox=True)  # -> Box, Box_2
area = Area(Geometry=bbox.Box)  # -> Area, Centroid
ln_3 = Line(StartPoint=pt_7, EndPoint=move_7.Geometry)
tan = TangentLines(Point=area.Centroid, Circle=move_6.Geometry)  # -> Tangent1, Tangent2
tan_2 = TangentLines(Point=area.Centroid, Circle=move_5.Geometry)  # -> Tangent1, Tangent2
move_8 = Move(Geometry=xz_2, Motion=area.Centroid)  # -> Geometry, Transform
join_2 = JoinCurves(Curves=[tan.Tangent2, tan_2.Tangent2], Preserve=False)
llx = LineLine(Line1=join_2, Line2=ln_3)  # -> ParamA, ParamB, PointA, PointB
ln_4 = Line(StartPoint=llx.PointA, EndPoint=area.Centroid)
ln_5 = Line(StartPoint=pt_7, EndPoint=llx.PointA)
rotate = Rotate(Geometry=[ln_4, ln_5], Angle=3.141592654, Plane=move_8.Geometry)  # -> Geometry, Transform
join_3 = JoinCurves(Curves=flatten([ln_3, ln_5, ln_4, rotate.Geometry]), Preserve=False)
offset_3 = Offset(Curve=join_3, Distance=expr("D/2", holder_thickness), Plane=PlaneXY(0, 0, 0), Corners=2)
offset_4 = Offset(Curve=join_3, Distance=expr("-D/2", holder_thickness), Plane=PlaneXY(0, 0, 0), Corners=2)
end_3 = EndPoints(Curve=offset_4)  # -> Start, End
end_4 = EndPoints(Curve=offset_3)  # -> Start, End
ln_6 = Line(StartPoint=end_4.Start, EndPoint=end_3.Start)
ln_7 = Line(StartPoint=end_4.End, EndPoint=end_3.End)
join_4 = JoinCurves(Curves=[offset_3, ln_6, offset_4, ln_7], Preserve=False)
extr_2 = Extrude(Base=join_4, Direction=Y)
cap_5 = CapHoles(Brep=extr_2)
preview_4 = CustomPreview(Geometry=cap_5, Shader=ColourSwatch(SwatchColor=RGB(161, 161, 161)))

# ---- group: Rods (continued)
vec_4 = VectorXYZ(XComponent=expression, YComponent=division_2, ZComponent=rod_z_offset)  # -> Vector, Length
move_9 = Move(Geometry=move_3.Geometry, Motion=vec_4.Vector)  # -> Geometry, Transform
split = SplitList(List=move_9.Geometry, Index=number_of_rods)  # -> ListA, ListB
preview_5 = CustomPreview(Geometry=split.ListA, Shader=ColourSwatch(SwatchColor=RGB(207, 207, 207)))

# ---- group: Walls (continued)
sdiff_2 = SolidDifference(BrepsA=move_4.Geometry, BrepsB=move_9.Geometry)
preview_6 = CustomPreview(Geometry=sdiff_2, Shader=ColourSwatch(SwatchColor=RGB(94, 72, 56)))
