# Grasshopper definition perforate.gh (Grasshopper 0.9.56)

number_slider = Slider(0.125, range=0..1)
brep = Brep(<brep referenced from the Rhino model>)
bbox = BoundingBox(Content=brep, Plane=PlaneXY(0, 0, 0))  # -> Box, Box_2
boxprop = BoxProperties(Box=bbox.Box)  # -> Center, Diagonal, Area, Volume, Degeneracy
box_corners = BoxCorners(Box=bbox.Box)  # -> CornerA, CornerB, CornerC, CornerD, CornerE, CornerF, CornerG, CornerH
multiplication = Multiplication(A=number_slider, B=2)
hexgrid = Hexagonal(Plane=box_corners.CornerA, Size=multiplication, ExtentX=Slider(10, range=0..20), ExtentY=Slider(8, range=0..20))  # -> Cells, Points
cir = Circle(Plane=hexgrid.Points, Radius=number_slider)
cyl = Cylinder(Base=hexgrid.Points, Radius=number_slider, Length=1)
cap = CapHoles(Brep=cyl)
bbox_2 = BoundingBox(Content=flatten(cap), Plane=PlaneXY(0, 0, 0), UnionBox=True)  # -> Box, Box_2
boxprop_2 = BoxProperties(Box=bbox_2.Box)  # -> Center, Diagonal, Area, Volume, Degeneracy
subtraction = Subtraction(A=boxprop.Center, B=boxprop_2.Center)
move = Move(Geometry=cap, Motion=subtraction)  # -> Geometry, Transform
sdiff = SolidDifference(BrepsA=brep, BrepsB=flatten(move.Geometry))
