# Grasshopper definition math.gh (Grasshopper 0.9.14)

int = Slider(18, range=-5..24)
int_2 = Slider(2, range=-5..24)
length = Slider(5, range=-5..24)
angle = Slider(45, range=-5..90)
square_root = SquareRoot(Value=int_2)
radians = Radians(Degrees=angle)
square = Square(Value=length)
panel = Panel(square_root)
addition = Addition(A=int, B=int_2)
subtraction = Subtraction(A=int, B=int_2)
multiplication = Multiplication(A=int, B=int_2)
power = Power(A=int, B=int_2)
expression = Expression(x=length, y=angle, Expression="x²*cos(y)")
cosine = Cosine(Value=radians)
panel_2 = Panel(addition)
panel_3 = Panel(power)
panel_4 = Panel(multiplication)
panel_5 = Panel(subtraction)
multiplication_2 = Multiplication(A=square, B=cosine)
panel_6 = Panel(multiplication_2)

number = Number([0.035, 0.07, 0.14, 0.28])
number_2 = Number(0.035)
# Hover cursor over components
integer = Integer(3)
integer_2 = Integer([3, 4, 5, 6])
panel_7 = Panel(integer)
panel_8 = Panel(integer_2)
panel_9 = Panel(number_2)
panel_10 = Panel(number)

int_3 = Slider(14, range=-5..24)
real = Slider(0.32, range=-1..1)
multiples_of_1_4 = Slider(11, range=0..25, expression="x*.25")
panel_11 = Panel([int_3, real, multiples_of_1_4])

panel_12 = Panel(expression)

md_slider = MDSlider(
    slider_value=Point(0.8146343696, 0.6219512195, 0.5),
    x_domain=Domain(0, 1),
    y_domain=Domain(0, 1),
    z_domain=Domain(0, 1),
    SliderMode=0)
decompose = Decompose(Point=md_slider, System=PlaneXY(0, 0, 0))  # -> XComponent, YComponent, ZComponent
panel_13 = Panel(md_slider)
panel_14 = Panel(decompose.XComponent)
panel_15 = Panel(decompose.YComponent)
panel_16 = Panel(decompose.ZComponent)
