# Grasshopper definition garbage can.gh (Grasshopper 0.9.6)

support_ring_outer_diameter = Slider(6.75, range=0..10)
support_ring_inner_diameter = Slider(5.25, range=0..10)
u_interlock_height = Slider(0.75, range=0..1)
u_arm_width = Slider(0.75, range=0..1)
width = Slider(7.5, range=0..10)
height = Slider(9, range=0..10)
material_thickness = Slider(0.49, range=0..1)
division = Division(A=width, B=2)
subtraction = Subtraction(A=division, B=u_arm_width)
xy = XYPlane(Origin=Point(0, 0, 0))
division_2 = Division(A=support_ring_outer_diameter, B=2)
division_3 = Division(A=support_ring_inner_diameter, B=2)
subtraction_2 = Subtraction(A=width, B=u_arm_width)
rectangle = Rectangle(Plane=xy, XSize=u_arm_width, YSize=height, Radius=0)  # -> Rectangle, Length
vec = VectorXYZ(XComponent=subtraction, YComponent=expr("-y/2", material_thickness), ZComponent=0)  # -> Vector, Length
cir = Circle(Plane=xy, Radius=division_2)
cir_2 = Circle(Plane=xy, Radius=division_3)
rectangle_2 = Rectangle(Plane=xy, XSize=width, YSize=u_interlock_height, Radius=0)  # -> Rectangle, Length
X = UnitX(Factor=subtraction_2)
rectangle_3 = Rectangle(Plane=vec.Vector, XSize=u_arm_width, YSize=material_thickness, Radius=0)  # -> Rectangle, Length
rectangle_4 = Rectangle(Plane=X, XSize=u_arm_width, YSize=height, Radius=0)  # -> Rectangle, Length
subtraction_3 = Subtraction(A=width, B=support_ring_outer_diameter)
division_4 = Division(A=material_thickness, B=2)
xy_2 = XYPlane(Origin=Point(0, 0, 0))
subtraction_4 = Subtraction(A=width, B=material_thickness)
division_5 = Division(A=subtraction_3, B=2)
subtraction_5 = Subtraction(A=height, B=division_4)
division_6 = Division(A=u_interlock_height, B=2)
division_7 = Division(A=subtraction_4, B=2)
offset = Offset(Curve=flatten(rectangle_3.Rectangle), Distance=0.05, Plane=xy_2, Corners=1)
runion = RegionUnion(Curves=[rectangle_4.Rectangle, rectangle.Rectangle, rectangle_2.Rectangle])
rotate = Rotate(Geometry=rectangle_3.Rectangle, Angle=3.141592654, Plane=xy_2)  # -> Geometry, Transform
vec_2 = VectorXYZ(XComponent=division_7, YComponent=division_6, ZComponent=0)  # -> Vector, Length
vec_3 = VectorXYZ(XComponent=division_5, YComponent=subtraction_5, ZComponent=0)  # -> Vector, Length
xy_3 = XYPlane(Origin=Point(0, 0, 0))
multiplication = Multiplication(A=u_arm_width, B=2)
rotate_2 = Rotate(Geometry=offset, Angle=[1.570796327, 3.141592654, 4.71238898], Plane=xy_2)  # -> Geometry, Transform
subtraction_6 = Subtraction(A=width, B=u_arm_width)
Y = UnitY(Factor=expr("-F", u_interlock_height))
rdiff = RegionDifference(CurvesA=[cir, cir_2], CurvesB=[rotate.Geometry, rectangle_3.Rectangle])
rectangle_5 = Rectangle(Plane=vec_2.Vector, XSize=material_thickness, YSize=u_interlock_height, Radius=0)  # -> Rectangle, Length
rectangle_6 = Rectangle(Plane=vec_3.Vector, XSize=division_5, YSize=material_thickness, Radius=0)  # -> Rectangle, Length
subtraction_7 = Subtraction(A=width, B=multiplication)
move = Move(Geometry=rectangle_5.Rectangle, Motion=Y)  # -> Geometry, Transform
cir_3 = Circle(Plane=xy_3, Radius=expr("R/2", width))
cir_4 = Circle(Plane=xy_3, Radius=expr("R/2", subtraction_6))
addition = Addition(A=subtraction_7, B=division_5)
X_2 = UnitX(Factor=addition)
division_8 = Division(A=height, B=2)
move_2 = Move(Geometry=rectangle_6.Rectangle, Motion=X_2)  # -> Geometry, Transform
Y_2 = UnitY(Factor=expr("-F", division_8))
group = Group(Objects=[cir_3, cir_4])
rdiff_2 = RegionDifference(CurvesA=runion, CurvesB=[move_2.Geometry, rectangle_6.Rectangle])
move_3 = Move(Geometry=[move_2.Geometry, rectangle_6.Rectangle], Motion=Y_2)  # -> Geometry, Transform
Y_3 = UnitY(Factor=height)
rdiff_3 = RegionDifference(CurvesA=rdiff_2, CurvesB=rectangle_5.Rectangle)
rdiff_4 = RegionDifference(CurvesA=rdiff_2, CurvesB=[move.Geometry, move_3.Geometry])
move_4 = Move(Geometry=rdiff_3, Motion=Y_3)  # -> Geometry, Transform
group_2 = Group(Objects=[move_4.Geometry, rdiff_4])
